# Grasshopper definition BASE.gh (Grasshopper 1.0.7)

# ----
# GEOOPT: LECTURE 02
# -INTERCONNECTION BETWEEN VS CODE AND GRASSHOPPER
# FILE PATH TO THE FILE
file_path = FilePath("C:\Users\Sachin\Desktop\Geopt\test.py")

# ----
# PROVIDE RAW FILE LINK TO GITHUB
panel = Panel("https://raw.githubusercontent.com/sachin-dabas/AIA-Geopt/main/test.py")

# ----
# REMOVE PER LINE TO REMOVE BLANK LINES
read_file = ReadFile(File=file_path, PerLineParse=False)  # -> Content
#   port File: Uri of file to read
# ---------- read_file: VB line parser ----------
    action = GH_LineParserAction.Include
    Return line

    'Parse the line and return some data that represents the line.
    'If the line cannot be parsed, you can return Nothing and
    'assign a different action.
    'The default implementation is to just return the line itself.
    'If you return types that implement IGH_Goo, this component
    'will work substantially faster.
# ---------- end read_file ----------

panel_2 = Panel(read_file)
# CODE FROM VS CODE
# 
# MENTION INPUTS & OUTPUT
ghpython_script = GhPythonScript(Code=read_file)  # -> Out, A, Length
ghpython_script_2 = GhPythonScript(fetch=Button(), url=panel)  # -> out, a
# ---------- ghpython_script_2: Python ----------
import clr # COMMON LANGUAGE RUNTIME LIBRARY // TRANSFORMS INTO CIL-COMMON INTERMEDIATE LANGUAGE 

clr.AddReference('System.Web.Extensions')
from System.Web.Script.Serialization import JavaScriptSerializer
from System.Net import WebClient

if fetch:
    
    # CREATE A WEB CLIENT
    client = WebClient()
    
    # DOWNLOAD THE RESULTS OF URL
    result = client.DownloadString(url)
    
a = result
# ---------- end ghpython_script_2 ----------
panel_3 = Panel(ghpython_script.Length)
ghpython_script_3 = GhPythonScript(Code=ghpython_script_2.a)  # -> Out, A
panel_4 = Panel(ghpython_script.Out)
