# Grasshopper definition MESH.gh (Grasshopper 1.0.7)

# BASIC MESH
point = Point([Point(24.31544308, 24.12845642, 0), Point(14.918762, 13.7512521, 0), Point(27.8289847, 5.743645621, 0), Point(47.8480009, 22.98451264, 0)])
ghpython_script = GhPythonScript(pts=point)  # -> out, a, b; inputs pts: list of Point3d
# ---------- ghpython_script: Python ----------
import Rhino.Geometry as rg
# CREATE A MESH
mesh = rg.Mesh() # EMPTY

# LIST OF VERTICES
print len(mesh.Vertices)

for p in pts:
    mesh.Vertices.Add(p)
    
print len(mesh.Vertices)

b = mesh.Vertices

# LIST OF FACES
print len(mesh.Faces)
mesh.Faces.AddFace(0,1,2,3)
a = mesh
# ---------- end ghpython_script ----------
ghpython_script_2 = GhPythonScript()  # -> out, a
# ---------- ghpython_script_2: Python ----------
import Rhino.Geometry as rg

for i in range(len(

mesh.Face
# ---------- end ghpython_script_2 ----------
point_list = PointList(Points=ghpython_script.b, Size=Slider(5, range=0..10))
