# Grasshopper definition Test for pfe.gh (Grasshopper 1.0.7)

file_path = FilePath("C:\Users\Sachin\Desktop\Geopt\Test 03.py")
read_file = ReadFile(File=file_path, PerLineParse=False)
panel = Panel(read_file)
ghpython_script = GhPythonScript(Code=read_file)  # -> Out, A, B
panel_2 = Panel(ghpython_script.Out)
geometry = Geometry(ghpython_script.Out)
